vi "index.gviweb"   [LabVIEW NXG 5.0.0]
panel controls:
  "Timezone": string
  "LV Enabled": bool = TRUE
  "LV TZ Update": bool
  "LV OS TZ Update": bool = TRUE
  "Pi OS TZ Update": bool = TRUE
  "LV OS Enabled": bool = TRUE
  "Pi OS Enabled": bool = TRUE
  "Debug Log?": bool
  "Send SystemLink Tags?": bool = TRUE
  "Send SystemLink Messages?": bool = TRUE
panel indicators:
  "Connected?": bool
  "LabVIEW Time": string
  "WebSockets URL": string
  "Last Error": string
  "LabVIEW OS Time": string
  "PI OS Time": string
types:
  "Message Session.gtype" = cluster{"Configuration": "Configuration.gtype", "token": string}
  T1 = cluster{"WebSockets URL": string, "WebSocket Session": u32, "Connected?": bool, "Message In": string, "Message Out": string, "LV TZ Update?": bool, "LV Time Update?": bool, "LV Time": string, "LV OS TZ Update?": bool, "LV OS Time Update?": bool, "LV OS Time": string, "Pi OS TZ Update?": bool, "Pi OS Time Update?": bool, "Pi OS Time": string, "State Control Refs": "CheckBox reference"[], "Debug Log?": bool, "Send SystemLink Tags?": bool, "Send SystemLink Messages?": bool, "Remote?": bool, "Message Session": "Message Session.gtype"}
  T2 = cluster{"Command": string, "Controls": cluster{"Name": string, "Value": bool}[]}
  T3 = cluster{"Controls": cluster{"Name": string, "Value": bool}[]}
uses:
  JKI::Library::JKI State Machine::Add State(s) to Queue.gvi
  JKI::Library::JKI State Machine::Parse State Queue.gvi
  NI::G Core::Error::Build Error Cluster.gvi
  DebugTools::Debug Log.gvi
  WebApp::GetHostname.jsli::GetHostname
  NI::WebSockets::Close WebSocket.gvi
  NI::G Core::Error::Clear Error Cluster.gvi
  NI::WebSockets::Open WebSocket.gvi
  NI::WebSockets::Read String.gvi
  NI::WebSockets::Write String.gvi
  NI::Skyline::Configuration::Open Configuration API Key.gvi
  NI::Skyline::MessageHTTP::Open.gvi
  NI::Skyline::MessageHTTP::Subscribe.gvi
  NI::Skyline::MessageHTTP::Read.gvi
  NI::Skyline::MessageHTTP::Publish.gvi
diagram:
  call "Add State(s) to Queue.gvi"(State(s) in ("")="Macro: Initialize") -> (States Out=w1)
  # This has been modified from the JKI State Machine NXG 3.0 available at https://github.com/JKISoftware/JKI-State-Machine-NXG/tree/master/source.  Instead of building a package the required VIs have been added to this project.  The items not supported by a Web VI have been removed.
  # = State Syntax =
  # StateCategory: State >> Argument
  # Line Terminator: Line feed
  # Example:
  # UI: Help >> About
  #
  # Where "UI" is the state category
  # Where "Help" is the state
  # Where "About" is the argument
  # Other Examples:
  # App Data: Initialize
  # UI: Initialize
  # Help >> About
  #
  # = Commenting =
  # To add a comment use "//" or "#" and all text to the right will be ignored
  # Commenting Example:
  # UI: Initialize // This initializes the UI
  # # This whole line is a comment
  # // Another comment line
  # For instructions on how to use the JKI State Machine, examples and video tutorials, visit:
  # http://jki.net/state-machine/
  #
  # JKI State Machine™
  # http://jki.net/state-machine/
  # Copyright (C) 2005-2018, JKI <info@jki.net>
  # ALL RIGHTS RESERVED
  s1 = uninitialised  # shift register
  s2 = uninitialised  # shift register
  s3 = w1  # shift register
  while {
    call "Parse State Queue.gvi"(State Queue=s3, Error In (no error)=s2) -> (Remaining States=w2, Current State=w3, Arguments=w4)
    w5 = 10  # Timeout
    # JKI State Machine NXG 3.0				Template Copyright © 2018 JKI	 - http://jki.net/state-machine
    # -1 =
    # wait
    # forever
    case (w3) ignore case {
      frame "", "Event Structure", "Idle" {
        # executes when the state queue is empty
        event (timeout = w5) {
          on "Timeout" {
            Property Node(instance in=s1) -> ("Connected?"=w10, "Remote?"=w11)
            # Timeout Frame
            # (this will only execute if the Event Structure timeout is >= 0)
            Select(s=w11, t="SystemLink: Read", f="WebSocket: Read") -> w12
            Select(s=w11, t="SystemLink: Read", f="WebSocket: Connecting") -> w13
            Select(s=w10, t=w12, f=w13) -> w14
            call "Add State(s) to Queue.gvi"(State(s) in Front ("")=w14, State(s) in ("")=w2, State(s) at Back ("")="UI: Update") -> (States Out=w7)
            w6 = s2
            w9 = s1
          }
          on "Timezone" Value changed {
            call "Add State(s) to Queue.gvi"(State(s) in Front ("")="UI: Process Timezone", State(s) in ("")=w2) -> (States Out=w7)
            w6 = s2
            w9 = s1
          }
          on "LV Enabled" Value changed; "LV OS Enabled" Value changed; "LV OS TZ Update" Value changed; "LV TZ Update" Value changed; "Pi OS Enabled" Value changed; "Pi OS TZ Update" Value changed; "Send SystemLink Messages?" Value changed; "Send SystemLink Tags?" Value changed {
            Event Data() -> ("New Value"=w15, "Control Reference"=w16)
            Property Node(instance in=w16) -> ("Label"=w17)
            Property Node(instance in=w17) -> ("Text"=w18)
            Format Into String(formatString="UI: Process Boolean >> %s,%s", w18, w15) -> w19
            call "Add State(s) to Queue.gvi"(State(s) in Front ("")=w19, State(s) in ("")=w2) -> (States Out=w7)
            w6 = s2
            w9 = s1
          }
          on "Debug Log?" Value changed {
            Event Data() -> ("New Value"=w20)
            Property Node(instance in=s1, "Debug Log?"=w20) -> (instance out=w9)
            w7 = w2
            w6 = s2
          }
        }
        w8 = default
      }
      frame "---------- Core ----------" {
        # Do not put any code in this frame.
        # (it is a separator no-op)
        call "Add State(s) to Queue.gvi"(State(s) in ("")=w2) -> (States Out=w7)
        w6 = s2
        w8 = default
        w9 = s1
      }
      frame Default {
        # Do not delete, rename, or modify this frame.
        # (this is used to capture unhandled states and typos)
        call "Add State(s) to Queue.gvi"(State(s) in ("")=w2) -> (States Out=w7)
        Format Into String(formatString="Software Exception: Unhandled State \"%s\".", errIn=s2, w3) -> (outString=w21, errOut=w22)
        # Handle mistyped state name (developer tool)
        call "Build Error Cluster.gvi"(code="Generic error"(42), description=w21, error in=w22, include call chain=TRUE) -> (error out=w6)
        w8 = default
        w9 = s1
      }
      frame "Error Handler" {
        # Handle any errors here.
        # You can also output any states to clean-up after errors occur
        call "Add State(s) to Queue.gvi"(State(s) in Front ("")="/* Post Error States", State(s) in ("")=w2) -> (States Out=w7)
        call "Debug Log.gvi"(prefix=w3, value=s2)
        Property Node(instance in=s2) -> ("code"=w23, "source"=w24)
        # Unhandled Error -- Display it
        Get Current Time() -> (current time=w25)
        Format Into String(formatString="%<%c>T\nCode: %d\n%s", w25, w23, w24) -> w26
        $"Last Error" <- w26
        # Clear error
        w6 = no error
        w8 = default
        w9 = s1
      }
      frame "Exit" {
        # Do not put any code in this frame.
        # (No errors that occur here will be handled.)
        call "Add State(s) to Queue.gvi"(State(s) in ("")=w2) -> (States Out=w7)
        w27 = TRUE  # Stop
        w6 = s2
        w8 = w27
        w9 = s1
      }
      frame "---------- Data ----------" {
        # Do not put any code in this frame.
        # (It is a separator no-op. You can make a copy of this frame to create a new Data frame)
        call "Add State(s) to Queue.gvi"(State(s) in ("")=w2) -> (States Out=w7)
        w6 = s2
        w8 = default
        w9 = s1
      }
      frame "Data: Initialize" {
        # Initialize the shift-register data, here.
        # (data names are defined by what you wire into the bundle function)
        call "Add State(s) to Queue.gvi"(State(s) in ("")=w2) -> (States Out=w7)
        # Add new data here.
        w28 = T1 {"LV Time Update?"=TRUE, "LV OS TZ Update?"=TRUE, "LV OS Time Update?"=TRUE, "Pi OS TZ Update?"=TRUE, "Pi OS Time Update?"=TRUE, "Send SystemLink Tags?"=TRUE, "Send SystemLink Messages?"=TRUE, "Remote?"=TRUE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}
        Build Array(reference to "LV Enabled", reference to "LV OS Enabled", reference to "Pi OS Enabled", reference to "LV TZ Update", reference to "LV OS TZ Update", reference to "Pi OS TZ Update", reference to "Send SystemLink Tags?", reference to "Send SystemLink Messages?") -> w29
        # Data names and types of shift register data are defined by this bundle.
        Property Node(instance in=w28, "State Control Refs"=w29) -> (instance out=w9)
        w6 = s2
        w8 = default
      }
      frame "Data: Cleanup" {
        # Cleanup any data and references, here.
        # (this is called automatically, by the Macro: Exit)
        call "Add State(s) to Queue.gvi"(State(s) in ("")=w2) -> (States Out=w7)
        w6 = s2
        w8 = default
        w9 = s1
      }
      frame "---------- UI ----------" {
        # Do not put any code in this frame.
        # (It is a separator no-op. You can make a copy of this frame to create a new UI frame)
        call "Add State(s) to Queue.gvi"(State(s) in ("")=w2) -> (States Out=w7)
        w6 = s2
        w8 = default
        w9 = s1
      }
      frame "UI: Initialize" {
        Property Node(instance in=s1) -> ("Remote?"=w30, "Debug Log?"=w31, "State Control Refs"=w32, "LV Time Update?"=w33, "LV OS Time Update?"=w34, "Pi OS Time Update?"=w35, "LV TZ Update?"=w36, "LV OS TZ Update?"=w37, "Pi OS TZ Update?"=w38, "Send SystemLink Tags?"=w39, "Send SystemLink Messages?"=w40, "Remote?"=w41)
        Select(s=w30, t="SystemLink: Initialize", f="WebSocket: Initialize") -> w42
        # Initialize the User Interface, here.
        # (this is called automatically, by the Macro: Init)
        call "Add State(s) to Queue.gvi"(State(s) in Front ("")=w42, State(s) in ("")=w2) -> (States Out=w7)
        Property Node(instance in=reference to "Debug Log?", "Value"=w31)
        Build Array(w33, w34, w35, w36, w37, w38, w39, w40) -> w43
        for {
          w44 = each element of w32
          w45 = each element of w43
          Property Node(instance in=w44, "Value"=w45)
        }
        Not(x=w41) -> w46
        Property Node(instance in=reference to "WebSockets URL", "Visible"=w46)
        $"Last Error" <- ""
        Property Node(instance in=reference to "Send SystemLink Messages?", "Visible"=w46)
        Property Node(instance in=reference to "Send SystemLink Tags?", "Visible"=w46)
        w6 = s2
        w8 = default
        w9 = s1
      }
      frame "UI: Update" {
        # Update the User Interface, here.
        # (this is called automatically, by the Macro: Init and during Timeout)
        call "Add State(s) to Queue.gvi"(State(s) in ("")=w2) -> (States Out=w7)
        Property Node(instance in=s1) -> ("WebSockets URL"=w47, "Connected?"=w48, "LV Time"=w49, "LV OS Time"=w50, "Pi OS Time"=w51)
        $"WebSockets URL" <- w47
        $"Connected?" <- w48
        $"LabVIEW Time" <- w49
        $"LabVIEW OS Time" <- w50
        $"PI OS Time" <- w51
        w6 = s2
        w8 = default
        w9 = s1
      }
      frame "UI: Process Timezone" {
        Property Node(instance in=reference to "Timezone", error in=s2) -> ("Value"=w52, error out=w53)
        w54 = cluster{"Command": string, "Timezone": string} {all zero or empty}
        Property Node(instance in=w54, "Command"="Timezone", "Timezone"=w52) -> (instance out=w55)
        Flatten To Json(anything=w55, error in (no error)=w53) -> (JSON string=w56, error out=w6)
        Property Node(instance in=s1, "Message Out"=w56) -> ("Remote?"=w57, "Debug Log?"=w58, instance out=w9)
        # UI: Process Timezone
        # (Process the Timezone change from the UI.)
        Select(s=w57, t="SystemLink: Write", f="WebSocket: Write") -> w59
        call "Add State(s) to Queue.gvi"(State(s) in ("")=w2, State(s) at Back ("")=w59) -> (States Out=w7)
        case (w58) {
          frame False, Default { }
          frame True {
            call "Debug Log.gvi"(prefix=w3, value=w9)
          }
        }
        w8 = default
      }
      frame "UI: Process Web UI State" {
        Property Node(instance in=s1) -> ("Remote?"=w60, "State Control Refs"=w61)
        Select(s=w60, t="SystemLink: Write", f="WebSocket: Write") -> w62
        # UI: Process Web UI State
        # (Get the current state of the state controls and send to the program.)
        call "Add State(s) to Queue.gvi"(State(s) in Front ("")=w62, State(s) in ("")=w2) -> (States Out=w7)
        s4 = s2  # shift register
        for {
          w63 = each element of w61
          Property Node(instance in=w63, error in=s4) -> ("Value"=w65, "Label"=w66, error out=w67)
          Property Node(instance in=w66, error in=w67) -> ("Text"=w68, error out=w69)
          Property Node(instance in=cluster{"Name": string, "Value": bool} {all zero or empty}, "Name"=w68, "Value"=w65) -> (instance out=w70)
          append w70 to w64
          next s4 = w69
        }
        Property Node(instance in=T2 {all zero or empty}, "Command"="Web UI State", "Controls"=w64) -> (instance out=w71)
        Flatten To Json(anything=w71, error in (no error)=s4) -> (JSON string=w72, error out=w6)
        Property Node(instance in=s1, "Message Out"=w72) -> (instance out=w9)
        w8 = default
      }
      frame "UI: Process Sync Web UI" {
        # UI: Process Sync Web UI
        # (Set the current state of the state controls to the Web UI.)
        call "Add State(s) to Queue.gvi"(State(s) in ("")=w2) -> (States Out=w7)
        Property Node(instance in=s1) -> ("Message In"=w73, "State Control Refs"=w74)
        Unflatten From Json(JSON string=w73, path=["Controls"], type and defaults=cluster{"Name": string, "Value": bool}[] []) -> (value=w75)
        for {
          w76 = each element of w75
          Property Node(instance in=w76) -> ("Value"=w78, "Name"=w79)
          s5 = s2  # shift register
          for {
            w80 = each element of w74
            Property Node(instance in=w80, error in=s5) -> ("Label"=w81, error out=w82, instance out=w83)
            Property Node(instance in=w81, error in=w82) -> ("Text"=w84, error out=w85)
            Is Equal(x=w79, y=w84) -> w86
            # For each available control.
            case (w86) {
              frame False, Default {
                # Control not found.
                w87 = w85
              }
              frame True {
                # Found control, set value.
                Property Node(instance in=w83, "Value"=w78, error in=w85) -> (error out=w87)
              }
            }
            next s5 = w87
            stop if w86
          }
          # For each control received.
          w88 = error {"status"=TRUE, "code"=5000, "source"="Unknown Boolean Command: %s"}
          Property Node(instance in=w88) -> ("source"=w89, instance out=w90)
          Format Into String(formatString=w89, w79) -> w91
          Property Node(instance in=w90, "source"=w91) -> (instance out=w92)
          Select(s=w86, t=s5, f=w92) -> w93
          append w93 to w77
        }
        Merge Errors(w77) -> (error out=w6)
        w8 = default
        w9 = s1
      }
      frame "UI: Process Boolean" {
        Search Or Split String(search string/char=",", string=w4) -> (match + rest of string=w94, substring before match=w95)
        String Subset(offset (0)=1, string=w94) -> w96
        Scan From String(inputString=w96, default=FALSE) -> (out0=w97)
        w98 = cluster{"Command": string, "Enabled?": bool} {all zero or empty}
        Property Node(instance in=w98, "Command"=w95, "Enabled?"=w97) -> (instance out=w99)
        Flatten To Json(anything=w99, error in (no error)=s2) -> (JSON string=w100, error out=w6)
        Property Node(instance in=s1, "Message Out"=w100) -> ("Remote?"=w101, "Debug Log?"=w102, instance out=w9)
        # UI: Process Boolean
        # (Process a boolean change from the UI.)
        Select(s=w101, t="SystemLink: Write", f="WebSocket: Write") -> w103
        call "Add State(s) to Queue.gvi"(State(s) in ("")=w2, State(s) at Back ("")=w103) -> (States Out=w7)
        case (w102) {
          frame False, Default { }
          frame True {
            call "Debug Log.gvi"(prefix=w3, value=w9)
          }
        }
        w8 = default
      }
      frame "UI: Process LV Time" {
        # UI: Process LV Time
        # (Process the LV Time Update.)
        call "Add State(s) to Queue.gvi"(State(s) in ("")=w2) -> (States Out=w7)
        Property Node(instance in=s1) -> ("Message In"=w104, instance out=w105)
        Unflatten From Json(JSON string=w104, error in (no error)=s2, path=["LV Time"], type and defaults=string "") -> (error out=w6, value=w106)
        Property Node(instance in=w105, "LV Time"=w106) -> (instance out=w9)
        w8 = default
      }
      frame "UI: Process LV OS Time" {
        # UI: Process LV OS Time
        # (Process the LV OS Time Update.)
        call "Add State(s) to Queue.gvi"(State(s) in ("")=w2) -> (States Out=w7)
        Property Node(instance in=s1) -> ("Message In"=w107, instance out=w108)
        Unflatten From Json(JSON string=w107, error in (no error)=s2, path=["LV OS Time"], type and defaults=string "") -> (error out=w6, value=w109)
        Property Node(instance in=w108, "LV OS Time"=w109) -> (instance out=w9)
        w8 = default
      }
      frame "UI: Process Pi OS Time" {
        # UI: Process Pi OS Time
        # (Process the Pi OS Time Update.)
        call "Add State(s) to Queue.gvi"(State(s) in ("")=w2) -> (States Out=w7)
        Property Node(instance in=s1) -> ("Message In"=w110, instance out=w111)
        Unflatten From Json(JSON string=w110, error in (no error)=s2, path=["Pi OS Time"], type and defaults=string "") -> (error out=w6, value=w112)
        Property Node(instance in=w111, "Pi OS Time"=w112) -> (instance out=w9)
        w8 = default
      }
      frame "---------- Macro ----------" {
        # Do not put any code in this frame.
        # (It is a separator no-op. You can make a copy of this frame to create a new Macro frame)
        call "Add State(s) to Queue.gvi"(State(s) in ("")=w2) -> (States Out=w7)
        w6 = s2
        w8 = default
        w9 = s1
      }
      frame "Macro: Initialize" {
        # Initialization Macro
        # (This is called once, when the VI starts)
        call "Add State(s) to Queue.gvi"(State(s) in Front ("")="Data: Initialize\nUI: Initialize\nUI: Update", State(s) in ("")=w2) -> (States Out=w7)
        w6 = s2
        w8 = default
        w9 = s1
      }
      frame "Macro: Exit" {
        # Exit Macro
        # (This is called once, when the VI exits)
        call "Add State(s) to Queue.gvi"(State(s) in Front ("")="Data: Cleanup\nExit", State(s) in ("")=w2) -> (States Out=w7)
        w6 = s2
        w8 = default
        w9 = s1
      }
      frame "---------- WebSocket ----------" {
        # Template Separator
        # (You can make a copy of, or modify, this frame)
        call "Add State(s) to Queue.gvi"(State(s) in ("")=w2) -> (States Out=w7)
        w6 = s2
        w8 = default
        w9 = s1
      }
      frame "WebSocket: Initialize" {
        # WebSocket: Initialize
        # (Establishes a connection with the webserver.)
        call "Add State(s) to Queue.gvi"(State(s) in ("")=w2) -> (States Out=w7)
        # Change this according to whether it's being hosted on the Pi (e.g. localhost) or you are accessing remotely (Pi IP address)
        disable {
          frame Enabled {
            # Use to test running locally.
            w6 = default
            w113 = "ws://labviewpi:6123"
          }
          frame Disabled {
            call "GetHostname"() -> (return=w114, error out=w115)
            Format Into String(formatString="ws://%s:6123", errIn=w115, w114) -> (outString=w113, errOut=w6)
          }
        }
        Property Node(instance in=s1, "WebSockets URL"=w113) -> (instance out=w9)
        w8 = default
      }
      frame "WebSocket: Connecting" {
        # WebSocket: Connecting
        # (Establish a WebSockets connection.)
        call "Add State(s) to Queue.gvi"(State(s) in ("")=w2) -> (States Out=w7)
        Property Node(instance in=s1) -> ("WebSockets URL"=w116, "WebSocket Session"=w117, instance out=w118)
        call "Close WebSocket.gvi"(websocket session in=w117, error in=s2) -> (error out=w119)
        call "Clear Error Cluster.gvi"(error in=w119) -> (error out=w120)
        call "Open WebSocket.gvi"(url=w116, error in=w120) -> (websocket session out=w121, error out=w122)
        Not(x=w122) -> w123
        Property Node(instance in=w118, "WebSocket Session"=w121, "Connected?"=w123) -> (instance out=w9)
        call "Clear Error Cluster.gvi"(error in=w122) -> (error out=w6)
        w8 = default
      }
      frame "WebSocket: Read" {
        Property Node(instance in=s1) -> ("WebSocket Session"=w124, instance out=w125)
        call "Read String.gvi"(websocket session in=w124, timeout=5, error in=s2) -> (websocket session out=w126, string response=w127, error out=w128)
        # WebSocket: Read
        # (Read any available message.)
        Select(s=w128, t="", f="Project: Process JSON") -> w129
        call "Add State(s) to Queue.gvi"(State(s) in Front ("")=w129, State(s) in ("")=w2) -> (States Out=w7)
        Not(x=w128) -> w130
        Property Node(instance in=w125, "WebSocket Session"=w126, "Message In"=w127, "Connected?"=w130) -> (instance out=w9)
        call "Clear Error Cluster.gvi"(error in=w128) -> (error out=w6)
        w8 = default
      }
      frame "WebSocket: Write" {
        # WebSocket: Write
        # (Write available message.)
        call "Add State(s) to Queue.gvi"(State(s) in ("")=w2) -> (States Out=w7)
        Property Node(instance in=s1) -> ("WebSocket Session"=w131, "Message Out"=w132, instance out=w133)
        call "Write String.gvi"(websocket session in=w131, string message=w132, error in=s2) -> (websocket session out=w134, error out=w135)
        Not(x=w135) -> w136
        Property Node(instance in=w133, "WebSocket Session"=w134, "Connected?"=w136) -> (instance out=w9)
        call "Clear Error Cluster.gvi"(error in=w135) -> (error out=w6)
        w8 = default
      }
      frame "---------- Project ----------" {
        # Template Separator
        # (You can make a copy of, or modify, this frame)
        call "Add State(s) to Queue.gvi"(State(s) in ("")=w2) -> (States Out=w7)
        w6 = s2
        w8 = default
        w9 = s1
      }
      frame "Project: Process JSON" {
        Property Node(instance in=s1) -> ("Message In"=w137, instance out=w138)
        Unflatten From Json(JSON string=w137, error in (no error)=s2, path=["Command"], type and defaults=string "") -> (error out=w139, value=w140)
        # Project: Process JSON
        # (Process the JSON message.)
        case (w140) {
          frame "LV Enabled", "LV OS Enabled", "LV OS TZ Update", "LV TZ Update", "Pi OS Enabled", "Pi OS TZ Update" {
            Unflatten From Json(JSON string=w137, error in (no error)=w139, path=["Enabled?"], type and defaults=bool FALSE) -> (error out=w142, value=w143)
            Property Node(instance in=cluster{"Name": string, "Value": bool} {all zero or empty}, "Name"=w140, "Value"=w143) -> (instance out=w144)
            Build Array(w144) -> w145
            Property Node(instance in=T3 {all zero or empty}, "Controls"=w145) -> (instance out=w146)
            Flatten To Json(anything=w146, error in (no error)=w142) -> (JSON string=w147, error out=w6)
            Property Node(instance in=w138, "Message In"=w147) -> (instance out=w9)
            w141 = "UI: Process Sync Web UI"
          }
          frame Default {
            Format Into String(formatString="UI: Process %s", errIn=w139, w140) -> (outString=w141, errOut=w6)
            w9 = w138
          }
        }
        call "Add State(s) to Queue.gvi"(State(s) in Front ("")=w141, State(s) in ("")=w2) -> (States Out=w7)
        w8 = default
      }
      frame "Project: Sync Web UI" {
        # Project: Sync Web UI
        # (Send Command to sync to the server.)
        call "Add State(s) to Queue.gvi"(State(s) in Front ("")="SystemLink: Write", State(s) in ("")=w2) -> (States Out=w7)
        Flatten To Json(anything=cluster{"Command": string} {"Command"="Sync Web UI"}, error in (no error)=s2) -> (JSON string=w148, error out=w6)
        Property Node(instance in=s1, "Message Out"=w148) -> (instance out=w9)
        w8 = default
      }
      frame "---------- SystemLink ----------" {
        # Template Separator
        # (You can make a copy of, or modify, this frame)
        call "Add State(s) to Queue.gvi"(State(s) in ("")=w2) -> (States Out=w7)
        w6 = s2
        w8 = default
        w9 = s1
      }
      frame "SystemLink: Initialize" {
        # SystemLink: Initialize
        # (Initialize the SystemLink Cloud connection.)
        call "Add State(s) to Queue.gvi"(State(s) in Front ("")="Project: Sync Web UI", State(s) in ("")=w2) -> (States Out=w7)
        call "Open Configuration API Key.gvi"(server url="https://api.systemlinkcloud.com", api key="Z11BYcjG7Q5ZNKbdVo3Ssxbzi7Re2rE2teXJZWmEuD", error in=s2) -> (configuration=w149, error out=w150)
        call "Open.gvi"(error in=w150, configuration=w149) -> (message session=w151, error out=w152)
        call "Subscribe.gvi"(message session in=w151, topic="CloudTest.Message.Out", error in=w152) -> (message session out=w153, error out=w6)
        Property Node(instance in=s1, "Message Session"=w153) -> (instance out=w9)
        w8 = default
      }
      frame "SystemLink: Read" {
        Property Node(instance in=s1) -> ("Message Session"=w154, "Connected?"=w155, instance out=w156)
        call "Read.gvi"(message session in=w154, timeout=1500, error in=s2) -> (dequeue status=w157, message session out=w158, message=w159, error out=w6)
        # SystemLink: Read
        # (Read an available SystemLink message.)
        Select(s=w157, t="Project: Process JSON", f="") -> w160
        Not(x=w155) -> w161
        Logical And(w161, w157) -> w162
        Select(s=w162, t="Project: Sync Web UI", f="") -> w163
        call "Add State(s) to Queue.gvi"(State(s) in Front ("")=w160, State(s) at Back ("")=w163) -> (States Out=w164)
        call "Add State(s) to Queue.gvi"(State(s) in Front ("")=w164, State(s) in ("")=w2) -> (States Out=w7)
        Property Node(instance in=w156, "Message Session"=w158, "Message In"=w159, "Connected?"=w157) -> (instance out=w9)
        w8 = default
      }
      frame "SystemLink: Write" {
        # SystemLink: Write
        # (Write available message.)
        call "Add State(s) to Queue.gvi"(State(s) in ("")=w2) -> (States Out=w7)
        Property Node(instance in=s1) -> ("Message Session"=w165, "Message Out"=w166, instance out=w167)
        call "Publish.gvi"(message session in=w165, topic="CloudTest.Message.In", message=w166, error in=s2) -> (message session out=w168, error out=w6)
        Property Node(instance in=w167, "Message Session"=w168) -> (instance out=w9)
        w8 = default
      }
    }
    next s1 = w9
    next s2 = w6
    next s3 = w7
    stop if w8
  }
